# Grasshopper definition 20240402 草模5版.gh (Grasshopper 1.0.7)
# plug-ins: Kangaroo2 Components

panel = Panel("曲线")
surface = Surface(<surface referenced from the Rhino model>)
triangular = Triangular(Plane=surface, Size=Slider(360, range=0..1000), ExtentX=Slider(100, range=0..100), ExtentY=Slider(67, range=0..100))  # -> Cells, Points

curve = Curve([<curve referenced from the Rhino model> x6])
point_list = PointList(Size=Slider(346, range=0..1000))
boundary_surfaces = BoundarySurfaces()

surface_2 = Surface(<surface referenced from the Rhino model>)
panel_2 = Panel("投影到曲面")
project = Project(Curve=triangular.Cells, Brep=surface_2, Direction=Vector(0, 0, 1))

discontinuity = Discontinuity(Curve=project, Level=1)  # -> Points, Parameters
point = Point([<point referenced from the Rhino model> x481])
delaunay_mesh = DelaunayMesh(Points=point, Plane=PlaneXY(0, 0, 0))
point_2 = Point(flatten(discontinuity.Points))
panel_3 = Panel(point_2)
tree_statistics = TreeStatistics(Tree=point_2)  # -> Paths, Length, Count
cull_duplicates = CullDuplicates(Points=point_2, Tolerance=0.1, CullMode=3)  # -> flatten(Points), Indices, Valence
panel_4 = Panel(tree_statistics.Paths)
sort_list = SortList(Keys=project)  # -> Keys, ValuesValuesA
flatten_tree = FlattenTree(Tree=project, Path="{0}")
panel_5 = Panel(cull_duplicates.Points)
line = Line([Line((-7650, 4520.652608, 0), (-2250, 4520.652608, 0)), Line((-2250, 4520.652608, 0), (450, 9197.189788, 0)), Line((450, 9197.189788, 0), (-2250, 13873.72697, 0)), Line((-2250, 13873.72697, 0), (-7650, 13873.72697, 0)), Line((-7650, 13873.72697, 0), (-10350, 9197.189788, 0)), Line((-10350, 9197.189788, 0), (-7650, 4520.652608, 0))])
series = Series(Start=0, Step=1, Count=tree_statistics.Count)
delaunay_mesh_2 = DelaunayMesh(Points=cull_duplicates.Points, Plane=PlaneXY(0, 0, 0))
panel_6 = Panel(flatten_tree)
show = Show(G=flatten_tree)
length_line = LengthLine(Line=[sort_list.ValuesValuesA, line], Strength=10)
shift_list = ShiftList(List=flatten(tree_statistics.Paths), Shift=series, Wrap=True)
deconstruct_mesh = DeconstructMesh(Mesh=delaunay_mesh_2)  # -> Vertices, Faces, Colours, Normals
mesh_edges = MeshEdges(Mesh=delaunay_mesh_2)  # -> NakedEdges, InteriorEdges, NonManifoldEdges

panel_7 = Panel("""135
166
150
119
197
181
165
134
104""")
panel_8 = Panel("""717
713
708
712
715
719
716
718
720""")
panel_9 = Panel("""120
151
136
105
182
167
152
121
91""")

panel_10 = Panel(length_line)
length_line_2 = LengthLine(Line=[mesh_edges.InteriorEdges, mesh_edges.NakedEdges], Strength=10)
list_item = ListItem(List=deconstruct_mesh.Vertices, Index=[panel_8, panel_7, panel_9], Wrap=True)
point_list_2 = PointList(Points=deconstruct_mesh.Vertices, Size=Slider(100, range=0..100))
panel_11 = Panel("""360
376
391
375
344
329
345
392
407
422
406
390
359
328
313
298
314
330
361""")
list_item_2 = ListItem(List=deconstruct_mesh.Vertices, Index=panel_11, Wrap=True)
load = Load(Point=deconstruct_mesh.Vertices, ForceVector=Vector(0, 0, 1), Weighting=1)
show_2 = Show(G=deconstruct_mesh.Vertices)
anchor = Anchor(Point=list_item, Strength=10000)
point_3 = Point(list_item_2)
deconstruct = Deconstruct(Point=point_3)  # -> XComponent, YComponent, ZComponent
construct_point = ConstructPoint(XCoordinate=deconstruct.XComponent, YCoordinate=deconstruct.YComponent, ZCoordinate=Slider(5000, range=0..10000))

discontinuity_2 = Discontinuity(Level=1)  # -> Points, Parameters
panel_12 = Panel(discontinuity_2.Points)
text_join = TextJoin(Text=discontinuity_2.Points)  # -> flatten(Result)
create_set = CreateSet(List=text_join)  # -> Set, Map
member_index = MemberIndex(Set=text_join, Member=create_set.Map)  # -> Index, Count
panel_13 = Panel(member_index.Index)
list_item_3 = ListItem(List=member_index.Index, Index=0, Wrap=True)  # -> flatten(Item)
list_item_4 = ListItem(List=discontinuity_2.Points, Index=list_item_3, Wrap=True)
panel_14 = Panel(list_item_3)
delaunay_mesh_3 = DelaunayMesh(Points=list_item_4, Plane=PlaneXY(0, 0, 0))
panel_15 = Panel(list_item_4)

polyline = PolyLine(Vertices=discontinuity_2.Points, Closed=False)
list_item_5 = ListItem(List=discontinuity_2.Points, Index=0, Wrap=True)
panel_16 = Panel(list_item_5)
anchor_2 = Anchor(Point=list_item_5, Strength=10000)
load_2 = Load(Point=polyline, ForceVector=Vector(0, 0, 1), Weighting=1)
panel_17 = Panel(load_2)
entwine = Entwine(Branch00=show, Branch01=load_2, Branch02=anchor_2, Branch03=length_line, FlattenInputs=True)
bouncysolver = BouncySolver(GoalObjects=entwine, Reset=Button(), Threshold=1e-15, Tolerance=0.01, Damping=0.99, Iterations=10, On=True)  # -> I, V, O
panel_18 = Panel(entwine)
deconstruct_2 = Deconstruct(Point=bouncysolver.V)  # -> XComponent, YComponent, ZComponent
list_item_6 = ListItem(List=bouncysolver.O, Index=0, Wrap=True)
bounds = Bounds(Numbers=deconstruct_2.ZComponent)
panel_19 = Panel(list_item_6)
anchor_3 = Anchor(Point=list_item_2, Target=construct_point, Strength=10000)
deconstruct_domain = DeconstructDomain(Domain=bounds)  # -> Start, End
entwine_2 = Entwine(Branch00=show_2, Branch01=load, Branch02=anchor, Branch03=anchor_3, Branch04=length_line_2, FlattenInputs=True)
gradient = Gradient(
    LowerLimit=deconstruct_domain.Start,
    UpperLimit=deconstruct_domain.End,
    Parameter=deconstruct_2.ZComponent,
    stops=[0: RGB(234, 38, 0), 0.25: RGB(234, 126, 0), 0.5: RGB(254, 244, 84), 0.75: RGB(173, 203, 249), 1: RGB(75, 107, 169)])
panel_20 = Panel(entwine_2)
bouncysolver_2 = BouncySolver(GoalObjects=entwine_2, Reset=False, Threshold=1e-15, Tolerance=0.01, Damping=0.99, Iterations=10, On=True)  # -> I, V, O
mesh_spray = MeshSpray(Mesh=list_item_6, Points=bouncysolver.V, Colours=gradient, SprayMode=11)
deconstruct_3 = Deconstruct(Point=bouncysolver_2.V)  # -> XComponent, YComponent, ZComponent
list_item_7 = ListItem(List=bouncysolver_2.O, Index=0, Wrap=True)
deconstruct_mesh_2 = DeconstructMesh(Mesh=mesh_spray)  # -> Vertices, Faces, Colours, Normals
panel_21 = Panel(gradient)
panel_22 = Panel(list_item_7)
bounds_2 = Bounds(Numbers=deconstruct_3.ZComponent)
deconstruct_domain_2 = DeconstructDomain(Domain=bounds_2)  # -> Start, End
gradient_2 = Gradient(
    LowerLimit=deconstruct_domain_2.Start,
    UpperLimit=deconstruct_domain_2.End,
    Parameter=deconstruct_3.ZComponent,
    stops=[0: RGB(234, 38, 0), 0.25: RGB(234, 126, 0), 0.5: RGB(254, 244, 84), 0.75: RGB(173, 203, 249), 1: RGB(75, 107, 169)])
mesh_spray_2 = MeshSpray(Mesh=list_item_7, Points=bouncysolver_2.V, Colours=gradient_2, SprayMode=11)
deconstruct_mesh_3 = DeconstructMesh(Mesh=mesh_spray_2)  # -> Vertices, Faces, Colours, Normals
